# Grasshopper definition 250410 Gable Prototype v3.gh (Grasshopper 1.0.7)
# plug-ins: Pufferfish, Weaverbird

# Max Boxes to Cut Doorways based on locations around the rectangle.
panel = Panel("Cut Skylight")

number_slider = Slider(3, range=0..7)
number_slider_2 = Slider(3, range=0..7)
number_slider_3 = Slider(2, range=0..7)

# ---- group: Roof Framing Distance
contour_distance = Slider(4, range=0..5)

# ----
md_slider = MDSlider(
    SliderMode=0,
    slider_value=Point(0.3865583466, 0.6994316287, 0.5),
    x_domain=Domain(0, 1),
    y_domain=Domain(0, 1),
    z_domain=Domain(0, 1))

# ---- group: Framing Depth
number_slider_4 = Slider(0.3, range=0..1)

# ---- group: Framing Height
number_slider_5 = Slider(-1.2, range=-5..5)

# ---- group: Roof Location
# Rectangle A = Roof (Area max 1600 SF)
# Rectangle B = Room (Area max 800 SF)
# Rectangle C = Plinth  (Area max1200 SF)
roof_x = Slider(24, range=0..100)
roof_y = Slider(28, range=0..100)

# ---- group: Roof Dimensions
roof_length = Slider(40, range=0..50)
roof_width = Slider(30, range=0..50)

# ---- group: Building Center
building_length = Slider(21, range=0..100)
building_width = Slider(25, range=0..100)

# ---- group: Building Dimensions
building_length_2 = Slider(30, range=0..50)
building_width_2 = Slider(15, range=0..50)

# ---- group: Plinth Center
plinth_length = Slider(13, range=0..100)
plinth_width = Slider(35, range=0..100)

# ---- group: Plinth Dimensions
plinth_length_2 = Slider(15, range=0..50)
plinth_width_2 = Slider(50, range=0..50)

# ---- group: Ridge Points
ridge_start_point_1 = Slider(0.1, range=0..1)
ridge_start_point_2 = Slider(0.55, range=0..1)

# ---- group: Ridge Height
ridge_height = Slider(20, range=0..30)

# ---- group: Gable Roof Rotation
rotation_in_degrees_left = Slider(-26, range=-90..90)
rotation_in_degrees_right = Slider(23, range=-90..90)

# ---- group: Door 1
number_slider_6 = Slider(0.038, range=0..1)
number_slider_7 = Slider(0.145, range=0..1)

# ---- group: Door 2
number_slider_8 = Slider(0.3, range=0..1)
number_slider_9 = Slider(0.433, range=0..1)

# ---- group: Door 3
number_slider_10 = Slider(0.711, range=0..1)
number_slider_11 = Slider(0.861, range=0..1)

# ---- group: Base Rectangle
rectangle = Rectangle(Plane=PlaneXY(0, 0, 0), XSize=Slider(50, range=0..100), YSize=Slider(50, range=0..100), Radius=0)  # -> Rectangle, Length

# ---- group: Roof
division = Division(A=roof_length, B="2")
division_2 = Division(A=roof_width, B="2")
pt = ConstructPoint(XCoordinate=0, YCoordinate=0, ZCoordinate=0)
X = UnitX(Factor=roof_x)
Y = UnitY(Factor=roof_y)
neg = Negative(Value=division)
neg_2 = Negative(Value=division_2)
move = Move(Geometry=pt, Motion=X)  # -> Geometry, Transform
move_2 = Move(Geometry=move.Geometry, Motion=Y)  # -> Geometry, Transform
dom = ConstructDomain(DomainStart=neg, DomainEnd=division)
dom_2 = ConstructDomain(DomainStart=neg_2, DomainEnd=division_2)
rectangle_2 = Rectangle(Plane=move_2.Geometry, XSize=dom, YSize=dom_2, Radius=0)  # -> Rectangle, Length
area = Area(Geometry=rectangle_2.Rectangle)  # -> Area, Centroid

# ----
roof_area = Panel(area.Area)

# ---- group: Building
division_3 = Division(A=building_length_2, B="2")
division_4 = Division(A=building_width_2, B="2")
pt_2 = ConstructPoint(XCoordinate=0, YCoordinate=0, ZCoordinate=0)
neg_3 = Negative(Value=division_4)
X_2 = UnitX(Factor=building_length)
Y_2 = UnitY(Factor=building_width)
neg_4 = Negative(Value=division_3)
move_3 = Move(Geometry=pt_2, Motion=X_2)  # -> Geometry, Transform
move_4 = Move(Geometry=move_3.Geometry, Motion=Y_2)  # -> Geometry, Transform
dom_3 = ConstructDomain(DomainStart=neg_4, DomainEnd=division_3)
dom_4 = ConstructDomain(DomainStart=neg_3, DomainEnd=division_4)
rectangle_3 = Rectangle(Plane=move_4.Geometry, XSize=dom_3, YSize=dom_4, Radius=0)  # -> Rectangle, Length
area_2 = Area(Geometry=rectangle_3.Rectangle)  # -> Area, Centroid

# ----
# Pick Three Points within a 50'x50 boundary rectangle.
building_area = Panel(area_2.Area)

# ---- group: Plinth
division_5 = Division(A=plinth_length_2, B="2")
division_6 = Division(A=plinth_width_2, B="2")
pt_3 = ConstructPoint(XCoordinate=0, YCoordinate=0, ZCoordinate=0)
X_3 = UnitX(Factor=plinth_length)
Y_3 = UnitY(Factor=plinth_width)
neg_5 = Negative(Value=division_5)
neg_6 = Negative(Value=division_6)
move_5 = Move(Geometry=pt_3, Motion=X_3)  # -> Geometry, Transform
move_6 = Move(Geometry=move_5.Geometry, Motion=Y_3)  # -> Geometry, Transform
dom_5 = ConstructDomain(DomainStart=neg_5, DomainEnd=division_5)
dom_6 = ConstructDomain(DomainStart=neg_6, DomainEnd=division_6)
rectangle_4 = Rectangle(Plane=move_6.Geometry, XSize=dom_5, YSize=dom_6, Radius=0)  # -> Rectangle, Length
area_3 = Area(Geometry=rectangle_4.Rectangle)  # -> Area, Centroid

# ----
# Pick 2 Points on opposite ends of the rectangle.
# Move the Surface Up a Distance
# Split the Surface with the Ridgeline
# Rotate Each Half a Certain Degree
plinth_area = Panel(area_3.Area)
geo = Geometry(rectangle_4.Rectangle)
geo_2 = Geometry(rectangle_3.Rectangle)
geo_3 = Geometry(rectangle_2.Rectangle)
debrep = DeconstructBrep(Brep=geo_3)  # -> Faces, graft(Edges), Vertices
bang = ExplodeTree(Data=simplify(debrep.Edges))  # -> Branch0, Branch1, Branch2, Branch3

# ---- group: Swap these for rotated ridge direction
geo_4 = Geometry(bang.Branch1)
geo_5 = Geometry(bang.Branch3)
geo_6 = Geometry(bang.Branch0)
geo_7 = Geometry(bang.Branch2)

# ----
eval = EvaluateCurve(Curve=reparameterize(geo_4), Parameter=ridge_start_point_1)  # -> Point, Tangent, Angle
eval_2 = EvaluateCurve(Curve=reparameterize(geo_5), Parameter=ridge_start_point_2)  # -> Point, Tangent, Angle
ln = Line(StartPoint=eval.Point, EndPoint=eval_2.Point)
srfsplit = SurfaceSplit(Surface=debrep.Faces, Curves=ln)  # -> graft(Fragments)
bang_2 = ExplodeTree(Data=simplify(srfsplit))  # -> Branch0, Branch1, Branch2, Branch3
end = EndPoints(Curve=ln)  # -> Start, End
panel_2 = Panel(srfsplit)
midpt = CurveMiddle(Curve=ln)
vec2pt = Vector2Pt(PointA=end.Start, PointB=end.End, Unitize=False)  # -> Vector, Length
geo_8 = Geometry(bang_2.Branch1)
geo_9 = Geometry(bang_2.Branch0)
rot3d = Rotate3D(Geometry=geo_8, Angle=degrees(rotation_in_degrees_right), Center=midpt, Axis=vec2pt.Vector)  # -> Geometry, Transform
rot3d_2 = Rotate3D(Geometry=geo_9, Angle=degrees(rotation_in_degrees_left), Center=midpt, Axis=vec2pt.Vector)  # -> Geometry, Transform

Z = UnitZ(Factor=ridge_height)
move_7 = Move(Geometry=ln, Motion=Z)  # -> Geometry, Transform

Z_2 = UnitZ(Factor=ridge_height)
move_8 = Move(Geometry=rot3d_2.Geometry, Motion=Z_2)  # -> Geometry, Transform
move_9 = Move(Geometry=rot3d.Geometry, Motion=Z_2)  # -> Geometry, Transform

# ---- group: Ridge Line
ridge_r = Geometry(move_7.Geometry)

# ----
join = BrepJoin(Breps=flatten([move_9.Geometry, move_8.Geometry]))  # -> Breps, Closed
geo_10 = Geometry(geo_2)

Z_3 = UnitZ(Factor="50")
extr = Extrude(Base=geo_10, Direction=Z_3)
split = SplitBrep(Brep=extr, Cutter=join.Breps)
item = ListItem(List=split, Index=Slider(1, range=0..1), Wrap=True)

# ---- group: UnSplit Walls
geo_11 = Geometry(item)

# ----
eval_3 = EvaluateCurve(Curve=reparameterize(geo_10), Parameter=number_slider_6)  # -> Point, Tangent, Angle
eval_4 = EvaluateCurve(Curve=reparameterize(geo_10), Parameter=number_slider_7)  # -> Point, Tangent, Angle
Z_4 = UnitZ(Factor="7")
move_10 = Move(Geometry=eval_4.Point, Motion=Z_4)  # -> Geometry, Transform
box = Box2Pt(PointA=eval_3.Point, PointB=move_10.Geometry, Plane=PlaneXY(0, 0, 0))
split_2 = SplitBrep(Brep=geo_11, Cutter=box)
item_2 = ListItem(List=split_2, Index=Slider(1, range=0..1), Wrap=True)

eval_5 = EvaluateCurve(Curve=reparameterize(geo_10), Parameter=number_slider_8)  # -> Point, Tangent, Angle
eval_6 = EvaluateCurve(Curve=reparameterize(geo_10), Parameter=number_slider_9)  # -> Point, Tangent, Angle
Z_5 = UnitZ(Factor="7")
move_11 = Move(Geometry=eval_6.Point, Motion=Z_5)  # -> Geometry, Transform
box_2 = Box2Pt(PointA=eval_5.Point, PointB=move_11.Geometry, Plane=PlaneXY(0, 0, 0))
split_3 = SplitBrep(Brep=item_2, Cutter=box_2)
item_3 = ListItem(List=split_3, Index=Slider(1, range=0..1), Wrap=True)

eval_7 = EvaluateCurve(Curve=reparameterize(geo_10), Parameter=number_slider_10)  # -> Point, Tangent, Angle
eval_8 = EvaluateCurve(Curve=reparameterize(geo_10), Parameter=number_slider_11)  # -> Point, Tangent, Angle
Z_6 = UnitZ(Factor="7")
move_12 = Move(Geometry=eval_8.Point, Motion=Z_6)  # -> Geometry, Transform
box_3 = Box2Pt(PointA=eval_7.Point, PointB=move_12.Geometry, Plane=PlaneXY(0, 0, 0))
split_4 = SplitBrep(Brep=item_3, Cutter=box_3)
item_4 = ListItem(List=split_4, Index=Slider(1, range=0..1), Wrap=True)

panel_3 = Panel(geo_11)
geo_12 = Geometry(join.Breps)

evalsrf = EvaluateSurface(Surface=reparameterize(geo_10), Point=md_slider)  # -> Point, Normal, UDirection, VDirection, Frame
Z_7 = UnitZ(Factor=1)
neg_7 = Negative(Value=number_slider_3)
neg_8 = Negative(Value=number_slider)
neg_9 = Negative(Value=number_slider_2)
project = ProjectPoint(Point=evalsrf.Point, Direction=Z_7, Geometry=geo_12)  # -> Point, Index
dom_7 = ConstructDomain(DomainStart=neg_8, DomainEnd=number_slider)
dom_8 = ConstructDomain(DomainStart=neg_9, DomainEnd=number_slider_2)
dom_9 = ConstructDomain(DomainStart=neg_7, DomainEnd=number_slider_3)
box_4 = CenterBox(Base=project.Point, X=dom_7, Y=dom_8, Z=dom_9)  # -> flatten(Box)
split_5 = SplitBrep(Brep=item_4, Cutter=box_4)
item_5 = ListItem(List=flatten(split_5), Index=Slider(0, range=0..1), Wrap=True)

split_6 = SplitBrep(Brep=geo_12, Cutter=box_4)
item_6 = ListItem(List=flatten(split_6), Index=Slider(0, range=0..1), Wrap=True)

midpt_2 = CurveMiddle(Curve=move_7.Geometry)
contour = Contour(Shape=geo_12, Point=midpt_2, Direction=vec2pt.Vector, Distance=contour_distance)  # -> flatten(Contours)
bbx = BrepBrep(BrepA=extr, BrepB=geo_12)  # -> Curves, Points
merge = Merge(Data1=move_7.Geometry, Data2=contour, Data3=bbx.Curves)  # -> flatten(Result)
Z_8 = UnitZ(Factor=number_slider_5)
extr_2 = Extrude(Base=flatten(merge), Direction=Z_8)  # -> flatten(Extrusion)
offsrf = OffsetSurface(Surface=extr_2, Distance=number_slider_4, BothSides=0, CreateSolid=True)  # -> flatten(Offset)
geo_13 = Geometry(flatten(item_6))

offsrf_2 = OffsetSurface(Surface=item_5, Distance=Slider(1, range=0..1), BothSides=0, CreateSolid=True)
sunion = SolidUnion(Breps=offsrf_2)  # -> flatten(Result)

Z_9 = UnitZ(Factor=Slider(0.9, range=-2..2))
extr_3 = Extrude(Base=geo_13, Direction=Z_9)

boundary = BoundarySurfaces(Edges=geo)
Z_10 = UnitZ(Factor=Slider(-1.9, range=-2..0))
geo_14 = Geometry(boundary)
extr_4 = Extrude(Base=geo_14, Direction=Z_10)

# ---- group: BUILDING - THIN
geo_15 = Geometry(<brep referenced from the Rhino model>)

# ---- group: ROOF - THIN
# make sure both roofs are joined, DIR pointing up
geo_16 = Geometry(<brep referenced from the Rhino model>)

# ---- group: PLINTH - THIN
geo_17 = Geometry(<brep referenced from the Rhino model>)

# ----
merge_2 = Merge(Data1=geo_16, Data2=geo_15, Data3=geo_17)

# ---- group: ROOF STRUCTURE - THICK
geo_18 = Geometry(offsrf)

# ---- group: BUILDING - THICK
geo_19 = Geometry(sunion)

# ----
panel_4 = Panel("specify offset type")

# ---- group: ROOF - THICK
geo_20 = Geometry(extr_3)

# ---- group: PLINTH - THICK
geo_21 = Geometry(extr_4)

# ---- group: PLINTH
swatch = ColourSwatch(SwatchColor=RGB(255, 255, 255))
preview = CustomPreview(Geometry=geo_21, Material=swatch)

# ---- group: ROOF FRAMING
swatch_2 = ColourSwatch(SwatchColor=RGB(186, 186, 186))
preview_2 = CustomPreview(Geometry=geo_18, Material=swatch)

# ---- group: ROOF
swatch_3 = ColourSwatch(SwatchColor=RGB(186, 186, 186))
preview_3 = CustomPreview(Geometry=geo_20, Material=swatch)

# ---- group: BUILDING
swatch_4 = ColourSwatch(SwatchColor=RGB(186, 186, 186))
preview_4 = CustomPreview(Geometry=geo_19, Material=swatch)

# ---- group: Thicken Surfaces to Watertight Meshes for 3D Printing using Weaverbird Plugin
roof_thickness = Slider(1.33, range=0..5)
wall_thickness = Slider(2, range=0..2)
plinth_thickness = Slider(1.5, range=0..2)
geo_22 = Geometry(geo_16)
smooth = SettingsQuality()
smooth_2 = SettingsQuality()
geo_23 = Geometry(geo_15)
geo_24 = Geometry(geo_17)
mesh = MeshBrep(Brep=geo_22, Settings=smooth_2)
mesh_2 = MeshBrep(Brep=geo_23, Settings=smooth)
mesh_3 = MeshBrep(
    Brep=geo_24,
    Settings={GridMaxCount=0, GridMinCount=16, JaggedSeams=False, MaxEdgeLength=0, MinEdgeLength=0.0001, MinTolerance=0, Refine=True, RefineAngle=0, RelativeTolerance=0.65, SimplePlanes=True, Tolerance=0})
neg_10 = Negative(Value=plinth_thickness)
wbthicken = WeaverbirdsMeshThicken(MeshCurves=mesh, Distance=roof_thickness, OffsetType=Slider(0, range=0..2))
wbthicken_2 = WeaverbirdsMeshThicken(MeshCurves=mesh_2, Distance=wall_thickness, OffsetType=0)
wbthicken_3 = WeaverbirdsMeshThicken(MeshCurves=mesh_3, Distance=neg_10, OffsetType=0)
merge_3 = Merge(Data1=wbthicken, Data2=wbthicken_2, Data3=wbthicken_3)
medges = MeshEdges(Mesh=wbthicken_2)  # -> NakedEdges, InteriorEdges, NonManifoldEdges
munion = MeshUnion(Meshes=graft(merge_3))
panel_5 = Panel(munion)

# ----
merge_4 = Merge(Data1=geo_18, Data2=geo_20, Data3=geo_19, Data4=geo_21)  # -> flatten(Result)
panel_6 = Panel(merge_4)
panel_7 = Panel("graft, not flatten")

# ---- group: WEAVERBIRD MESH FOR 3D PRINT
preview_5 = CustomPreview(Geometry=munion, Material=ColourSwatch(SwatchColor=RGB(255, 255, 255)))
