# Grasshopper definition 250918 Gable Prototype, GPT readable.ghx (Grasshopper 1.0.7)
# plug-ins: Pufferfish

panel = Panel("Cut Skylight")  # disabled

# ----
# Rectangle A = Roof (Area max 1600 SF)
# Rectangle B = Room (Area max 800 SF)
# Rectangle C = Plinth  (Area max1200 SF)
number_slider = Slider(0.711, range=0..1)  # disabled
number_slider_2 = Slider(0.861, range=0..1)  # disabled

evaluate_curve = EvaluateCurve(Parameter=number_slider)  # -> Point, Tangent, Angle; disabled
evaluate_curve_2 = EvaluateCurve(Parameter=number_slider_2)  # -> Point, Tangent, Angle; disabled
panel_2 = Panel("7")  # disabled
unit_z = UnitZ(Factor=panel_2)  # disabled
move = Move(Geometry=evaluate_curve_2.Point, Motion=unit_z)  # -> Geometry, Transform; disabled
box_2pt = Box2Pt(PointA=evaluate_curve.Point, PointB=move.Geometry, Plane=PlaneXY(0, 0, 0))  # disabled
number_slider_3 = Slider(1, range=0..1)  # disabled
split_brep = SplitBrep(Cutter=box_2pt)  # disabled
list_item = ListItem(List=split_brep, Index=number_slider_3, Wrap=True)  # disabled
# Max Boxes to Cut Doorways based on locations around the rectangle.
panel_3 = Panel("Cut Skylight")  # disabled
panel_4 = Panel("old")
panel_5 = Panel("new")
geometry = Geometry(<curve referenced from the Rhino model>)  # disabled
point = Point(<point referenced from the Rhino model>)  # disabled
point_2 = Point(<point referenced from the Rhino model>)  # disabled

number_slider_4 = Slider(10, range=0..10)
number_slider_5 = Slider(10, range=0..10)
number_slider_6 = Slider(10, range=0..10)
number_slider_7 = Slider(10, range=0..10)
geometry_2 = Geometry(<curve referenced from the Rhino model>)
geometry_3 = Geometry(<curve referenced from the Rhino model>)
geometry_4 = Geometry(<curve referenced from the Rhino model>)
geometry_5 = Geometry(<curve referenced from the Rhino model>)
ghpython_script = GhPythonScript(
    roof_plan=geometry_5,
    wall_fp=geometry_4,
    plinth_fp=geometry_2,
    ridge_crv_in=geometry_3,
    ridge_h=Slider(10, range=0..10),
    roof_overhang=Slider(10, range=0..10),
    roof_t=Slider(5, range=0..10),
    plinth_h=Slider(2, range=0..10),
    framing_spacing=Slider(4, range=0..10),
    skylight_size=Slider(10, range=0..10))  # -> plinth_brep, walls_brep, roof_brep, ridge_crv, rafters, skylights, report; inputs roof_plan: Curve, wall_fp: Curve, plinth_fp: Curve, ridge_crv_in: Curve, skylight_pts: list of Point3d, door_boxes: list of Brep
# ---------- ghpython_script: Python ----------
# Decoupled Gable: independent roof/walls/plinth + optional ridge input
# See input list above for type hints.

import math
import Rhino
import Rhino.Geometry as rg

def _tol():
    try:
        return Rhino.RhinoDoc.ActiveDoc.ModelAbsoluteTolerance
    except:
        return 1e-6

def _fail(msg):
    ghenv.Component.Message = msg
    return (None, None, None, None, [], [], "ERROR: " + msg)

def _ensure_planar_closed(curv, name, tol):
    if curv is None: return False, name + " missing."
    if not curv.IsClosed: return False, name + " must be closed."
    if not curv.IsPlanar(tol): return False, name + " must be planar."
    return True, ""

def _plane_of(curv):
    ok, pl = curv.TryGetPlane()
    if not ok: pl = rg.Plane.WorldXY
    return pl

def _poly_from(curv):
    ok, pl = curv.TryGetPolyline()
    return (ok, pl)

def _edges_from_poly(pl):
    edges = [rg.Line(pl[i], pl[i+1]).ToNurbsCurve() for i in range(pl.Count-1)]
    return edges[:4] if len(edges) >= 4 else edges

def _offset_or_self(curv, pln, d, tol):
    if not d or abs(d) <= tol: return curv
    offs = rg.Curve.Offset(curv, pln, d, tol, rg.CurveOffsetCornerStyle.Sharp)
    if offs:
        # pick largest loop
        best = None; area = -1.0
        for c in offs:
            am = rg.AreaMassProperties.Compute(c)
            a = abs(am.Area) if am else -1.0
            if a > area: best, area = c, a
        return best
    return curv

def _move_curve_between_parallel_planes(crv, src_pl, dst_pl):
    x = rg.Transform.Translation(dst_pl.Origin - src_pl.Origin)
    dup = crv.DuplicateCurve()
    dup.Transform(x)
    return dup

def _align_edge_to_ridge(edge_crv, ra, rb):
    a, b = edge_crv.PointAtStart, edge_crv.PointAtEnd
    keep = a.DistanceTo(ra) + b.DistanceTo(rb)
    flip = a.DistanceTo(rb) + b.DistanceTo(ra)
    if flip < keep: edge_crv.Reverse()
    return edge_crv

def _auto_ridge_from_plan(plan_crv, base_pl, tol):
    ok, pl = _poly_from(plan_crv)
    if not ok or pl.Count < 5:
        # fallback via planar brep
        breps = rg.Brep.CreatePlanarBreps(plan_crv, tol)
        if not breps: return None
        joined = rg.Curve.JoinCurves([e.DuplicateCurve() for e in breps[0].Edges], tol)
        if not joined: return None
        ok, pl = joined[0].TryGetPolyline()
        if not ok: return None
    edges = _edges_from_poly(pl)
    if len(edges) < 2: return None
    # pick a "long" edge
    lens = [e.GetLength() for e in edges]
    i_long = lens.index(max(lens))
    long_edge = edges[i_long]
    long_len  = long_edge.GetLength()
    dir_vec = long_edge.PointAtEnd - long_edge.PointAtStart
    if dir_vec.IsTiny(): return None
    dir_vec.Unitize()
    bb = plan_crv.GetBoundingBox(True)
    ctr = bb.Center
    ra = rg.Point3d(ctr) - dir_vec * (0.5 * long_len)
    rb = rg.Point3d(ctr) + dir_vec * (0.5 * long_len)
    return rg.Line(ra, rb).ToNurbsCurve(), dir_vec, ctr

def main(roof_plan, wall_fp, plinth_fp, ridge_crv_in,
         roof_overhang, wall_h, ridge_h, roof_t, plinth_h,
         framing_spacing, rafter_w, rafter_d,
         skylight_pts, skylight_size, door_boxes):

    tol = _tol()

    # ---- Validate base inputs (independent) ----
    if wall_fp is None and roof_plan is None:
        return _fail("Provide at least wall_fp or roof_plan.")

    # Planes & footprints
    # Walls
    if wall_fp is not None:
        ok, msg = _ensure_planar_closed(wall_fp, "wall_fp", tol)
        if not ok: return _fail(msg)
        wall_fp = wall_fp.ToNurbsCurve()
        wall_pl = _plane_of(wall_fp)
    else:
        wall_pl = rg.Plane.WorldXY

    # Roof plan
    if roof_plan is not None:
        ok, msg = _ensure_planar_closed(roof_plan, "roof_plan", tol)
        if not ok: return _fail(msg)
        roof_plan = roof_plan.ToNurbsCurve()
        roof_pl = _plane_of(roof_plan)
    else:
        # derive roof from wall_fp + overhang
        if wall_fp is None:
            return _fail("roof_plan missing and wall_fp missing; cannot derive roof.")
        roof_pl = wall_pl
        roof_plan = _offset_or_self(wall_fp, wall_pl, roof_overhang or 0.0, tol)

    # Plinth plan
    if plinth_fp is not None:
        ok, msg = _ensure_planar_closed(plinth_fp, "plinth_fp", tol)
        if not ok: return _fail(msg)
        plinth_fp = plinth_fp.ToNurbsCurve()
        plinth_pl = _plane_of(plinth_fp)
    else:
        plinth_fp = wall_fp if wall_fp is not None else roof_plan
        plinth_pl = _plane_of(plinth_fp)

    # ---- Build walls & plinth (independent) ----
    walls_brep = None
    if wall_fp is not None and wall_h and abs(wall_h) > tol:
        ex = rg.Extrusion.Create(wall_fp, wall_h, True)
        if ex: walls_brep = ex.ToBrep()

    plinth_brep = None
    if plinth_fp is not None and plinth_h and abs(plinth_h) > tol:
        ex = rg.Extrusion.Create(plinth_fp, plinth_h, True)
        if ex: plinth_brep = ex.ToBrep()

    # ---- Ridge (auto or provided) ----
    if ridge_crv_in is not None:
        ridge_crv = ridge_crv_in.ToNurbsCurve()
        long_dir = ridge_crv.PointAtEnd - ridge_crv.PointAtStart
        if long_dir.IsTiny(): return _fail("Provided ridge_crv_in is degenerate.")
        long_dir.Unitize()
        ctr = ridge_crv.PointAtNormalizedLength(0.5)
    else:
        res = _auto_ridge_from_plan(roof_plan, roof_pl, tol)
        if res is None: return _fail("Could not auto-detect ridge from roof_plan.")
        ridge_crv, long_dir, ctr = res

    ridge_len = ridge_crv.GetLength()
    if ridge_len < tol: return _fail("Ridge length too small.")

    # --- Make the roof "fall" to the wall top ---
    # 1) Drop axis (gravity)
    if wall_fp is not None:
        drop_axis = wall_pl.ZAxis
        wall_top_origin = wall_pl.Origin + wall_pl.ZAxis * (wall_h or 0.0)
    else:
        drop_axis = rg.Vector3d(0, 0, 1)
        wall_top_origin = roof_pl.Origin
    if drop_axis.IsTiny():
        drop_axis = rg.Vector3d(0, 0, 1)

    # 2) Eave plane through wall top, normal = drop axis
    eave_pl = rg.Plane(wall_top_origin, drop_axis)

    # 3) Project roof footprint & ridge onto eave plane
    roof_eave_outline = rg.Curve.ProjectToPlane(roof_plan, eave_pl)
    ridge_eave = rg.Curve.ProjectToPlane(ridge_crv, eave_pl)

    # 4) Raise ridge by ridge_h
    ridge_top = ridge_eave.DuplicateCurve()
    ridge_top.Transform(rg.Transform.Translation(drop_axis * (ridge_h or 0.0)))
    

    # 5) From the eave outline, pick opposite eave edges across ridge-perpendicular
    ok_poly, rpl = roof_eave_outline.TryGetPolyline()
    if not ok_poly or rpl.Count < 5:
        rbp = rg.Brep.CreatePlanarBreps(roof_eave_outline, tol)
        if not rbp:
            return _fail("roof_eave_outline must be a single loop.")
        joined = rg.Curve.JoinCurves([e.DuplicateCurve() for e in rbp[0].Edges], tol)
        if not joined:
            return _fail("Failed to prepare eave outline.")
        ok_poly, rpl = joined[0].TryGetPolyline()
        if not ok_poly:
            return _fail("Eave outline is not polyline-like.")

    # Build edges from the eave polyline
    edges = [rg.Line(rpl[i], rpl[i+1]).ToNurbsCurve() for i in range(rpl.Count - 1)]

    # Determine directions in eave plane
    long_dir = ridge_eave.PointAtEnd - ridge_eave.PointAtStart
    if long_dir.IsTiny():
        return _fail("Ridge too short after projection.")
    long_dir.Unitize()
    perp = rg.Vector3d.CrossProduct(drop_axis, long_dir)
    if perp.IsTiny():
        perp = rg.Vector3d(-long_dir.Y, long_dir.X, long_dir.Z)
    perp.Unitize()
    ctr = roof_eave_outline.GetBoundingBox(True).Center

    def signed_along_perp(crv):
        mp = crv.PointAtNormalizedLength(0.5)
        return rg.Vector3d.Multiply(mp - ctr, perp)

    edges_sorted = sorted(edges, key=signed_along_perp)
    eave1 = edges_sorted[0]
    eave2 = edges_sorted[-1]

    # Align eave directions to the full ridge (consistent start/end)
    eave1 = _align_edge_to_ridge(eave1, ridge_eave.PointAtStart, ridge_eave.PointAtEnd)
    eave2 = _align_edge_to_ridge(eave2, ridge_eave.PointAtStart, ridge_eave.PointAtEnd)

    # --- Force a single, shared ridge (split once at midpoint) ---
    dom = ridge_top.Domain
    mid = 0.5 * (dom.T0 + dom.T1)
    ridge_top_1 = ridge_top.Trim(dom.T0, mid)
    ridge_top_2 = ridge_top.Trim(mid, dom.T1)

    # Optionally re-align eaves to their specific ridge segments
    def _align_to_seg(eave_edge, seg):
        return _align_edge_to_ridge(eave_edge, seg.PointAtStart, seg.PointAtEnd)

    eave1 = _align_to_seg(eave1, ridge_top_1)
    eave2 = _align_to_seg(eave2, ridge_top_2)

    # ---- Loft halves (each uses its half of the shared ridge) ----
    def _loft_half(ridge_seg_top, eave_edge_aligned):
        loft = rg.Brep.CreateFromLoft(
            [eave_edge_aligned, ridge_seg_top],
            rg.Point3d.Unset, rg.Point3d.Unset,
            rg.LoftType.Straight, False
        )
        return loft[0] if loft and len(loft) else None

    half1 = _loft_half(ridge_top_1, eave1)
    half2 = _loft_half(ridge_top_2, eave2)
    if not (half1 and half2):
        return _fail("Loft failed with shared ridge halves.")


    # ---- Join halves → shell ----
    shell = None
    j = rg.Brep.JoinBreps([half1, half2], tol)
    if j and len(j) == 1:
        shell = j[0]
    if shell is None:
        m = rg.Brep.MergeBreps([half1, half2], tol)
        if m:
            shell = m
    if shell is None:
        s = rg.Brep.CreateSolid([half1, half2], tol)
        if s and len(s) == 1:
            shell = s[0]
    if shell is None:
        return _fail("Could not join roof halves.")

    # ---- Thicken to solid (symmetric offset) ----
    roof_brep = None
    if roof_t and abs(roof_t) > tol:
        off1 = rg.Brep.CreateOffsetBrep(shell, roof_t/2.0, False, True, tol)
        if off1 and len(off1) == 1:
            off2 = rg.Brep.CreateOffsetBrep(off1[0], -roof_t, False, True, tol)
            if off2 and len(off2) == 1:
                j2 = rg.Brep.JoinBreps([off1[0], off2[0]], tol)
                if j2 and len(j2) == 1:
                    roof_brep = j2[0]
    if roof_brep is None:
        roof_brep = shell

    # ---- Framing (true 3D solid rafters on roof planes) ----

    def _auto_rafter_sizes(spacing_val, path_len):
        # Sensible defaults: width ~ 15% of spacing, depth ~ 8% of rafter length,
        # and keep depth at least 2x width.
        w = max(0.15 * max(spacing_val, tol), 0.05)
        d = max(0.08 * max(path_len, tol), 2.0 * w)
        return w, d

    def _rect_profile_at_start(rail_crv, roof_brep_ref, width, depth):
        # Plane at rail start: X = rail tangent, Z = roof normal, Y = Z x X
        t0 = rail_crv.Domain.T0
        p0 = rail_crv.PointAtStart
        tan = rail_crv.TangentAt(t0)
        if not tan or tan.IsTiny():
            tan = rg.Vector3d(1, 0, 0)
        tan.Unitize()

        # --- Find roof normal at the closest BrepFace ---
        n = None
        min_dist = 1e9
        for f in roof_brep_ref.Faces:
            rc, u, v = f.ClosestPoint(p0)
            if rc:
                ptf = f.PointAt(u, v)
                d = ptf.DistanceTo(p0)
                if d < min_dist:
                    min_dist = d
                    n = f.NormalAt(u, v)
        if n is None or n.IsTiny():
            n = drop_axis
        n.Unitize()

        # --- Flip normal if it's pointing opposite the drop axis ---
        if rg.Vector3d.Multiply(n, drop_axis) < 0:
            n.Reverse()

        y = rg.Vector3d.CrossProduct(n, tan)
        if y.IsTiny():
            # fallback if tan ~ n
            y = rg.Vector3d(-tan.Y, tan.X, 0.0)
        y.Unitize()

        # Shift base point DOWN by full depth (always below roof surface now)
        offset_origin = p0 - n * depth

        pA = offset_origin + (-y * (width * 0.5))
        pB = offset_origin + ( y * (width * 0.5))
        pC = offset_origin + ( y * (width * 0.5) + n * depth)
        pD = offset_origin + (-y * (width * 0.5) + n * depth)
        sec = rg.Polyline([pA, pB, pC, pD, pA]).ToNurbsCurve()
        return sec

    rafters = []
    rafters_paths = []  # keep the intersection curves too (not returned, but handy if you want)

    if framing_spacing and framing_spacing > tol and ridge_len > tol:

        # 1) Divide the projected ridge by length = spacing
        t_params = ridge_eave.DivideByLength(max(framing_spacing, tol), True)
        if not t_params or len(t_params) == 0:
            # fallback to at least 6 divisions
            min_count = max(int(math.floor(ridge_len / max(framing_spacing, tol))), 6)
            dom = ridge_eave.Domain
            t_params = [dom.T0 + (dom.Length * i / float(max(1, min_count))) for i in range(min_count + 1)]

        # 2) Perpendicular direction in eave plane
        ridge_vec = ridge_eave.PointAtEnd - ridge_eave.PointAtStart
        if ridge_vec.IsTiny(): ridge_vec = rg.Vector3d(1, 0, 0)
        ridge_vec.Unitize()
        perp_vec = rg.Vector3d.CrossProduct(drop_axis, ridge_vec)
        if perp_vec.IsTiny(): perp_vec = rg.Vector3d(-ridge_vec.Y, ridge_vec.X, 0.0)
        perp_vec.Unitize()

        # 3) For each division, create a long cutting line, extrude up, intersect with roof to get the 3D path
        rafter_paths = []
        for t in t_params:
            p = ridge_eave.PointAt(t)
            base_line = rg.Line(p - perp_vec * 1e3, p + perp_vec * 1e3).ToNurbsCurve()
            base_line = rg.Curve.ProjectToPlane(base_line, eave_pl)

            ext_h = (abs(ridge_h or 0.0) + abs(wall_h or 0.0) + 5.0)
            ext = rg.Extrusion.Create(base_line, ext_h, True)
            if not ext: 
                continue
            ext_brep = ext.ToBrep()

        # 3) For each division, create a long cutting line, extrude up, intersect with each roof half
        rafter_paths = []
        for t in t_params:
            p = ridge_eave.PointAt(t)
            base_line = rg.Line(p - perp_vec * 1e3, p + perp_vec * 1e3).ToNurbsCurve()
            base_line = rg.Curve.ProjectToPlane(base_line, eave_pl)

            ext_h = (abs(ridge_h or 0.0) + abs(wall_h or 0.0) + 5.0)
            ext = rg.Extrusion.Create(base_line, ext_h, True)
            if not ext:
                continue
            ext_brep = ext.ToBrep()

            paths_here = []
            for slope in [half1, half2]:
                if not slope:
                    continue
                bx = rg.Intersect.Intersection.BrepBrep(ext_brep, slope, tol)
                if not bx or bx[1] is None:
                    continue
                icrvs = list(bx[1])
                for crv in icrvs:
                    if crv and crv.GetLength() > tol:
                        paths_here.append(crv.DuplicateCurve())

            # add both slope paths
            rafter_paths.extend(paths_here)


        # 4) Build solid rafters by sweeping a rectangle along each path
        sweep = rg.SweepOneRail()
        sweep.AngleToleranceRadians = Rhino.RhinoMath.ToRadians(1.0)
        sweep.ClosedSweep = False
        sweep.SweepTolerance = tol

        for path in rafter_paths:
            path_len = path.GetLength()
            # Determine section sizes (override with inputs if positive; else auto)
            if (rafter_w is not None and rafter_w > tol) and (rafter_d is not None and rafter_d > tol):
                w, d = rafter_w, rafter_d
            else:
                w, d = _auto_rafter_sizes(framing_spacing, path_len)

            section = _rect_profile_at_start(path, roof_brep, w, d)
            try:
                breps = sweep.PerformSweep(path, [section])
                if breps and len(breps) > 0:
                    # Join segments if sweep returns multiple
                    joined = rg.Brep.JoinBreps(list(breps), tol)
                    rafters.append(joined[0] if joined and len(joined) == 1 else breps[0])
                    rafters_paths.append(path)
            except:
                # Ignore failed sweep on a single path; continue others
                continue


    # ---- Skylights (projected squares on eave plane) ----
    skylights = []
    if skylight_pts and skylight_size and skylight_size > tol:
        halfS = skylight_size * 0.5
        z0 = eave_pl.Origin.Z
        for pt in skylight_pts:
            sq = rg.Polyline([
                rg.Point3d(pt.X - halfS, pt.Y - halfS, z0),
                rg.Point3d(pt.X + halfS, pt.Y - halfS, z0),
                rg.Point3d(pt.X + halfS, pt.Y + halfS, z0),
                rg.Point3d(pt.X - halfS, pt.Y + halfS, z0),
                rg.Point3d(pt.X - halfS, pt.Y - halfS, z0),
            ]).ToNurbsCurve()
            skylights.append(sq)

    # ---- Door cuts (walls only) ----
    if walls_brep and door_boxes:
        cutters = [b for b in door_boxes if isinstance(b, rg.Brep)]
        if cutters:
            diff = rg.Brep.CreateBooleanDifference(walls_brep, cutters, tol)
            if diff and len(diff) > 0:
                walls_brep = diff[0]

    # ---- Report ----
    ghenv.Component.Message = "Decoupled Gable"
    rep = []
    rep.append("Decoupled Gable")
    rep.append("Walls: {}".format("yes" if walls_brep else "no"))
    rep.append("Roof: {}".format("yes" if roof_brep else "no"))
    rep.append("Plinth: {}".format("yes" if plinth_brep else "no"))
    rep.append("Ridge length: {:.3f}".format(ridge_len))
    report = "\n".join(rep)

    return (plinth_brep, walls_brep, roof_brep, ridge_crv, rafters, skylights, report)


# ---------- Optional defaults so it runs standalone ----------
if wall_fp is None: wall_fp = rg.Rectangle3d(rg.Plane.WorldXY, 20.0, 10.0).ToNurbsCurve()
if roof_plan is None: roof_plan = None  # will derive from wall_fp + roof_overhang
if plinth_fp is None: plinth_fp = None
if ridge_crv_in is None: ridge_crv_in = None

if roof_overhang is None: roof_overhang = 0.5
if wall_h is None: wall_h = 10.0
if ridge_h is None: ridge_h = 1.0
if roof_t is None: roof_t = 0.25
if plinth_h is None: plinth_h = -0.5
if framing_spacing is None: framing_spacing = 2.0
if rafter_w is None: rafter_w = 0.0   # auto-size if <= 0
if rafter_d is None: rafter_d = 0.0
if skylight_pts is None: skylight_pts = []
if skylight_size is None: skylight_size = 0.0
if door_boxes is None: door_boxes = []

# ---------- Call ----------
plinth_brep, walls_brep, roof_brep, ridge_crv, rafters, skylights, report = main(
    roof_plan, wall_fp, plinth_fp, ridge_crv_in,
    roof_overhang, wall_h, ridge_h, roof_t, plinth_h,
    framing_spacing, rafter_w, rafter_d,
    skylight_pts, skylight_size, door_boxes
)
# ---------- end ghpython_script ----------

# ---- group: Building Dimensions
building_length = Slider(12, range=0..25)  # disabled
building_width = Slider(15, range=0..25)  # disabled

# ---- group: Roof Location
roof_x = Slider(24, range=0..100)  # disabled
roof_y = Slider(18, range=0..100)  # disabled

# ---- group: Roof Dimensions
roof_length = Slider(14, range=0..30)  # disabled
roof_width = Slider(21, range=0..30)  # disabled

# ---- group: Building Center
building_length_2 = Slider(24, range=0..100)  # disabled
building_width_2 = Slider(20, range=0..100)  # disabled

# ---- group: Plinth Center
building_length_3 = Slider(13, range=0..100)  # disabled
building_width_3 = Slider(27, range=0..100)  # disabled

# ---- group: Plinth Dimensions
building_length_4 = Slider(20, range=0..50)  # disabled
building_width_4 = Slider(10, range=0..50)  # disabled

# ----
number_slider_8 = Slider(0.6, range=0..1)  # disabled
number_slider_9 = Slider(0.9, range=0..1)  # disabled

# ---- group: Ridge Height
ridge_height = Slider(16, range=0..30)  # disabled

# ----
number_slider_10 = Slider(0, range=0..1)  # disabled
number_slider_11 = Slider(0.145, range=0..1)  # disabled

number_slider_12 = Slider(0.287, range=0..1)  # disabled
number_slider_13 = Slider(0.369, range=0..1)  # disabled

number_slider_14 = Slider(0.711, range=0..1)  # disabled
number_slider_15 = Slider(0.861, range=0..1)  # disabled

number_slider_16 = Slider(5, range=0..7)  # disabled
number_slider_17 = Slider(3, range=0..7)  # disabled
number_slider_18 = Slider(3, range=0..7)  # disabled

md_slider = MDSlider(
    SliderMode=0,
    slider_value=Point(0.3013493608, 0.3174215177, 0.5),
    x_domain=Domain(0, 1),
    y_domain=Domain(0, 1),
    z_domain=Domain(0, 1))  # disabled
ghpython_script_2 = GhPythonScript(rect_crv=geometry, ridge_a=point, ridge_b=point_2)  # -> plinth_brep, walls_brep, roof_brep, ridge_crv, rafters, skylights, report; inputs rect_crv: Curve, ridge_a: Point3d, ridge_b: Point3d, skylight_pts: list of Point3d, door_boxes: list of Brep; disabled
# ---------- ghpython_script_2: Python ----------
# Gable Prototype – GhPython (explicit args to main)

import math
import Rhino
import Rhino.Geometry as rg

rect_crv = rg.Rectangle3d(rg.Plane.WorldXY, 10, 5).ToNurbsCurve()

if rect_crv is None:
    rect_crv = rg.Rectangle3d(rg.Plane.WorldXY, 10, 5).ToNurbsCurve()


def _doc_tol():
    try:
        return Rhino.RhinoDoc.ActiveDoc.ModelAbsoluteTolerance
    except:
        return 1e-6

def _fail(msg):
    ghenv.Component.Message = msg
    return (None, None, None, None, [], [], "ERROR: " + msg)

def _rectangle_edges_from_curve(crv):
    ok, pl = crv.TryGetPolyline()
    if ok and pl and pl.Count >= 5:
        edges = []
        for i in range(pl.Count - 1):
            ln = rg.Line(pl[i], pl[i+1])
            edges.append(ln.ToNurbsCurve())
        if len(edges) >= 4:
            edges = edges[:4]
        return edges
    return []

def _move_curve_between_parallel_planes(crv, src_plane, dst_plane):
    dz = dst_plane.Origin - src_plane.Origin
    xform = rg.Transform.Translation(dz)
    dup = crv.DuplicateCurve()
    dup.Transform(xform)
    return dup

def _project_point_to_plane(pt, plane):
    t = plane.DistanceTo(pt)
    return pt - plane.ZAxis * t

def main(rect_crv, ridge_a, ridge_b,
         wall_h, ridge_h, overhang,
         roof_t, plinth_h,
         framing_spacing, rafter_w, rafter_d,
         skylight_pts, skylight_size,
         door_boxes):

    tol = _doc_tol()

    # 0) Validate base rectangle
    if rect_crv is None or not rect_crv.IsClosed or not rect_crv.IsPlanar():
        return _fail("Provide a closed planar rectangle curve.")

    ok_plane, base_pln = rect_crv.TryGetPlane()
    if not ok_plane:
        base_pln = rg.Plane.WorldXY

    rect_crv_n = rect_crv.ToNurbsCurve()
    amp = rg.AreaMassProperties.Compute(rect_crv_n)
    rect_area = amp.Area if amp else 0.0

    # 1) Overhang footprint (roof plan)
    if overhang and abs(overhang) > tol:
        offs = rg.Curve.Offset(rect_crv_n, base_pln, overhang, tol, rg.CurveOffsetCornerStyle.Sharp)
        if offs:
            def _area_abs(c):
                am = rg.AreaMassProperties.Compute(c)
                return abs(am.Area) if am else 0.0
            roof_plan = max(offs, key=_area_abs)
        else:
            roof_plan = rect_crv_n
    else:
        roof_plan = rect_crv_n

    # 2) Walls + plinth
    walls_brep = None
    if wall_h and abs(wall_h) > tol:
        extr_w = rg.Extrusion.Create(rect_crv_n, wall_h, True)
        if extr_w:
            walls_brep = extr_w.ToBrep()

    plinth_brep = None
    if plinth_h and abs(plinth_h) > tol:
        extr_p = rg.Extrusion.Create(rect_crv_n, plinth_h, True)
        if extr_p:
            plinth_brep = extr_p.ToBrep()

    # 3) Ridge line (eave elevation)
    if ridge_a is None or ridge_b is None:
        return _fail("Provide ridge_a and ridge_b points (plan).")

    eave_pln = rg.Plane(base_pln)
    eave_pln.Origin = base_pln.Origin + base_pln.ZAxis * (wall_h if wall_h else 0.0)

    ra = _project_point_to_plane(ridge_a, eave_pln)
    rb = _project_point_to_plane(ridge_b, eave_pln)
    ridge_crv = rg.Line(ra, rb).ToNurbsCurve()
    ridge_len = ridge_crv.GetLength()
    if ridge_len < tol:
        return _fail("Ridge length is zero or too small.")

    # 4) Find two eave edges most parallel to ridge
    ok_pl, pl = roof_plan.TryGetPolyline()
    if not ok_pl or pl.Count < 5:
        breps = rg.Brep.CreatePlanarBreps(roof_plan, tol)
        if not breps:
            return _fail("Could not derive rectangle edges from roof plan.")
        pl = breps[0].DuplicateEdgeCurves()
        # build a polyline approximation
        roof_plan = rg.Curve.JoinCurves(pl, tol)[0]
        ok_pl, pl = roof_plan.TryGetPolyline()
        if not ok_pl:
            return _fail("Roof plan is not a rectangle polyline.")

    # 4 straight edges from polyline
    rect_edges = [rg.Line(pl[i], pl[i+1]).ToNurbsCurve() for i in range(pl.Count-1)]
    if len(rect_edges) != 4:
        return _fail("Expected 4 edges from roof plan.")

    # Use signed distance along ridge-perpendicular to pick opposite edges
    ridge_dir = (rb - ra); ridge_dir.Unitize()
    perp = rg.Vector3d(-ridge_dir.Y, ridge_dir.X, 0.0); 
    if perp.IsTiny(): perp = base_pln.XAxis
    perp.Unitize()

    # center of rectangle
    bb = roof_plan.GetBoundingBox(True)
    ctr = bb.Center

    def signed_offset_along_perp(crv):
        mp = crv.PointAtNormalizedLength(0.5)
        v = mp - ctr
        return rg.Vector3d.Multiply(v, perp)

    scored = sorted(rect_edges, key=signed_offset_along_perp)
    eave_low  = scored[0]
    eave_high = scored[-1]  # opposite side across ridge normal

    # Make sure the ridge line starts near start of eaves to avoid loft twist
    ridge_crv = rg.Line(ra, rb).ToNurbsCurve()  # ensure this is (ra -> rb)

    def align_dir_to_point(crv, ref_pt):
        # reverse curve if its start is farther from ref_pt than its end
        if crv.PointAtStart.DistanceTo(ref_pt) > crv.PointAtEnd.DistanceTo(ref_pt):
            crv.Reverse()
        return crv

    eave_low  = align_dir_to_point(eave_low,  ra)
    eave_high = align_dir_to_point(eave_high, ra)

    # Elevate eaves to eave plane
    eave1_elev = _move_curve_between_parallel_planes(eave_low,  base_pln, eave_pln)
    eave2_elev = _move_curve_between_parallel_planes(eave_high, base_pln, eave_pln)

    # Make sure ridge is ra -> rb
    ridge_crv = rg.Line(ra, rb).ToNurbsCurve()

    def match_curve_endpoints_to_ridge(edge_crv, ra, rb):
        """
        Orient the eave edge so its start is closer to ra and its end closer to rb.
        This prevents the loft from crossing (bow-tie).
        """
        a = edge_crv.PointAtStart
        b = edge_crv.PointAtEnd
        cost_keep = a.DistanceTo(ra) + b.DistanceTo(rb)
        cost_flip = a.DistanceTo(rb) + b.DistanceTo(ra)
        if cost_flip < cost_keep:
            edge_crv.Reverse()
        return edge_crv

    eave1_elev = match_curve_endpoints_to_ridge(eave1_elev, ra, rb)
    eave2_elev = match_curve_endpoints_to_ridge(eave2_elev, ra, rb)

    # Raise ridge to ridge_top after directions are fixed
    ridge_top = ridge_crv.DuplicateCurve()
    ridge_top.Transform(rg.Transform.Translation(eave_pln.ZAxis * ridge_h))
    
    # -----------------------------
    # 5) Create sloped halves via loft to raised ridge
    ridge_top = ridge_crv.DuplicateCurve()
    ridge_top.Transform(rg.Transform.Translation(eave_pln.ZAxis * ridge_h))

    def _loft_half(ridge_line, eave_edge):
        loft = rg.Brep.CreateFromLoft(
            [eave_edge, ridge_line],
            rg.Point3d.Unset, rg.Point3d.Unset,
            rg.LoftType.Straight, False
        )
        return loft[0] if loft and len(loft) else None

    half1 = _loft_half(ridge_top, eave1_elev)
    half2 = _loft_half(ridge_top, eave2_elev)
    if not (half1 and half2):
        return _fail("Loft failed. Check ridge/eave alignment.")

    # -----------------------------
    # Join halves into a thin shell
    # -----------------------------
    shell = None  # <-- ensure it's always defined
    joined = rg.Brep.JoinBreps([half1, half2], tol)
    if joined and len(joined) == 1:
        shell = joined[0]
    if shell is None:
        merged = rg.Brep.MergeBreps([half1, half2], tol)
        if merged:
            shell = merged
    if shell is None:
        solid_try = rg.Brep.CreateSolid([half1, half2], tol)
        if solid_try and len(solid_try) == 1:
            shell = solid_try[0]
    if shell is None:
        return _fail("Could not join roof halves into a shell.")

    # -----------------------------
    # Thicken to solid (symmetric offset)
    # -----------------------------
    roof_brep = None
    if roof_t and abs(roof_t) > tol:
        first = rg.Brep.CreateOffsetBrep(shell, roof_t / 2.0, False, True, tol)
        if first and len(first) == 1:
            second = rg.Brep.CreateOffsetBrep(first[0], -roof_t, False, True, tol)
            if second and len(second) == 1:
                joined_thick = rg.Brep.JoinBreps([first[0], second[0]], tol)
                if joined_thick and len(joined_thick) == 1:
                    roof_brep = joined_thick[0]

    # Fallback: if offset/join failed, just use the shell
    if roof_brep is None:
        roof_brep = shell

    # 6) Framing (plan rafters ⟂ to ridge)
    rafters = []
    if framing_spacing and framing_spacing > tol and ridge_len > tol:
        nsteps = int(math.floor(ridge_len / max(framing_spacing, tol)))
        rideline = rg.Line(ridge_crv.PointAtStart, ridge_crv.PointAtEnd)

        # perpendicular to ridge in the base/eave plane
        ridge_dir = (rb - ra); ridge_dir.Unitize()
        perp = rg.Vector3d(-ridge_dir.Y, ridge_dir.X, 0.0)
        if perp.IsTiny(): perp = base_pln.XAxis
        perp.Unitize()

        for i in range(nsteps + 1):
            t = float(i) / max(1, nsteps)
            p = rideline.PointAt(t * rideline.Length)

            raw = rg.Line(p - perp * 1e3, p + perp * 1e3).ToNurbsCurve()
            # ensure the trimming curve lies exactly on the plan plane
            raw = rg.Curve.ProjectToPlane(raw, base_pln)

            x = rg.Intersect.Intersection.CurveCurve(raw, roof_plan, tol, tol)
            if x and len(x) >= 2:
                t0 = x[0].ParameterA; t1 = x[1].ParameterA
                tmin, tmax = (min(t0, t1), max(t0, t1))
                seg = raw.Trim(tmin, tmax)
                if seg: rafters.append(seg) 

    # 7) Skylight markers (plan squares)
    skylights = []
    if skylight_pts and skylight_size and skylight_size > tol:
        half = skylight_size * 0.5
        z0 = (base_pln.Origin + base_pln.ZAxis * (wall_h if wall_h else 0.0)).Z
        for pt in skylight_pts:
            sq = rg.Polyline([
                rg.Point3d(pt.X - half, pt.Y - half, z0),
                rg.Point3d(pt.X + half, pt.Y - half, z0),
                rg.Point3d(pt.X + half, pt.Y + half, z0),
                rg.Point3d(pt.X - half, pt.Y + half, z0),
                rg.Point3d(pt.X - half, pt.Y - half, z0),
            ]).ToNurbsCurve()
            skylights.append(sq)

    # 8) Door cuts (optional)
    if walls_brep and door_boxes:
        cutters = [b for b in door_boxes if isinstance(b, rg.Brep)]
        if cutters:
            diff = rg.Brep.CreateBooleanDifference(walls_brep, cutters, tol)
            if diff and len(diff) > 0:
                walls_brep = diff[0]

    # 9) Report
    ghenv.Component.Message = "Gable Prototype"
    report_lines = [
        "Gable Prototype",
        "Rect area: {:.2f}".format(rect_area),
        "Wall height: {:.3f}".format(wall_h),
        "Ridge rise: {:.3f}".format(ridge_h),
        "Overhang: {:.3f}".format(overhang),
        "Roof thickness: {:.3f}".format(roof_t),
        "Plinth height: {:.3f}".format(plinth_h),
        "Ridge length: {:.3f}".format(ridge_len),
    ]
    report = "\n".join(report_lines)

    return (plinth_brep, walls_brep, roof_brep, ridge_crv, rafters, skylights, report)

wall_h = 10.0
ridge_h = 3.0
overhang = 0.0
roof_t = 0.5
plinth_h = 1.0
framing_spacing =0.2
rafter_w = 0.3
rafter_d = 0.5
skylight_pts = [rg.Point3d(2, 2, 0)]
skylight_size = 2.0
door_boxes = []

# ---------- CALL MAIN WITH EXPLICIT GH INPUTS ----------
plinth_brep, walls_brep, roof_brep, ridge_crv, rafters, skylights, report = main(
    rect_crv, ridge_a, ridge_b,
    wall_h, ridge_h, overhang,
    roof_t, plinth_h,
    framing_spacing, rafter_w, rafter_d,
    skylight_pts, skylight_size,
    door_boxes
)
# ---------- end ghpython_script_2 ----------

# ---- group: ROOF FRAMING
colour_swatch = ColourSwatch(SwatchColor=RGB(186, 186, 186))  # disabled
custom_preview = CustomPreview(Material=colour_swatch)  # disabled

# ----
construct_point = ConstructPoint(XCoordinate=0, YCoordinate=0, ZCoordinate=0)  # disabled
construct_point_2 = ConstructPoint(XCoordinate=0, YCoordinate=0, ZCoordinate=0)  # disabled
construct_point_3 = ConstructPoint(XCoordinate=0, YCoordinate=0, ZCoordinate=0)  # disabled
unit_x = UnitX(Factor=building_length_2)  # disabled
unit_y = UnitY(Factor=building_width_2)  # disabled
unit_x_2 = UnitX(Factor=roof_x)  # disabled
unit_y_2 = UnitY(Factor=roof_y)  # disabled
negative = Negative(Value=building_width)  # disabled
negative_2 = Negative(Value=building_length)  # disabled
negative_3 = Negative(Value=roof_length)  # disabled
negative_4 = Negative(Value=roof_width)  # disabled
unit_x_3 = UnitX(Factor=building_length_3)  # disabled
unit_y_3 = UnitY(Factor=building_width_3)  # disabled
negative_5 = Negative(Value=building_length_4)  # disabled
negative_6 = Negative(Value=building_width_4)  # disabled

# ---- group: Base Rectangle
number_slider_19 = Slider(50, range=0..100)  # disabled
number_slider_20 = Slider(50, range=0..100)  # disabled
rectangle = Rectangle(Plane=PlaneXY(0, 0, 0), XSize=number_slider_19, YSize=number_slider_20, Radius=0)  # -> Rectangle, Length; disabled

# ----
construct_domain = ConstructDomain(DomainStart=negative_2, DomainEnd=building_length)  # disabled
construct_domain_2 = ConstructDomain(DomainStart=negative, DomainEnd=building_width)  # disabled
construct_domain_3 = ConstructDomain(DomainStart=negative_3, DomainEnd=roof_length)  # disabled
construct_domain_4 = ConstructDomain(DomainStart=negative_4, DomainEnd=roof_width)  # disabled
construct_domain_5 = ConstructDomain(DomainStart=negative_5, DomainEnd=building_length_4)  # disabled
construct_domain_6 = ConstructDomain(DomainStart=negative_6, DomainEnd=building_width_4)  # disabled
move_2 = Move(Geometry=construct_point, Motion=unit_x)  # -> Geometry, Transform; disabled
move_3 = Move(Geometry=move_2.Geometry, Motion=unit_y)  # -> Geometry, Transform; disabled
move_4 = Move(Geometry=construct_point_2, Motion=unit_x_2)  # -> Geometry, Transform; disabled
move_5 = Move(Geometry=move_4.Geometry, Motion=unit_y_2)  # -> Geometry, Transform; disabled
move_6 = Move(Geometry=construct_point_3, Motion=unit_x_3)  # -> Geometry, Transform; disabled
move_7 = Move(Geometry=move_6.Geometry, Motion=unit_y_3)  # -> Geometry, Transform; disabled
unit_z_2 = UnitZ(Factor=1)  # disabled
panel_6 = Panel("50")  # disabled
rectangle_2 = Rectangle(Plane=move_3.Geometry, XSize=construct_domain, YSize=construct_domain_2, Radius=0)  # -> Rectangle, Length; disabled
rectangle_3 = Rectangle(Plane=move_5.Geometry, XSize=construct_domain_3, YSize=construct_domain_4, Radius=0)  # -> Rectangle, Length; disabled
rectangle_4 = Rectangle(Plane=move_7.Geometry, XSize=construct_domain_5, YSize=construct_domain_6, Radius=0)  # -> Rectangle, Length; disabled
unit_z_3 = UnitZ(Factor=panel_6)  # disabled
area = Area(Geometry=rectangle_3.Rectangle)  # -> Area, Centroid; disabled
roof_area = Panel(area.Area)  # disabled
area_2 = Area(Geometry=rectangle_2.Rectangle)  # -> Area, Centroid; disabled
building_area = Panel(area_2.Area)  # disabled
area_3 = Area(Geometry=rectangle_4.Rectangle)  # -> Area, Centroid; disabled
plinth_area = Panel(area_3.Area)  # disabled
negative_7 = Negative(Value=number_slider_18)  # disabled
negative_8 = Negative(Value=number_slider_16)  # disabled
negative_9 = Negative(Value=number_slider_17)  # disabled
construct_domain_7 = ConstructDomain(DomainStart=negative_7, DomainEnd=number_slider_18)  # disabled
construct_domain_8 = ConstructDomain(DomainStart=negative_8, DomainEnd=number_slider_16)  # disabled
construct_domain_9 = ConstructDomain(DomainStart=negative_9, DomainEnd=number_slider_17)  # disabled
panel_7 = Panel("7")  # disabled
panel_8 = Panel("7")  # disabled
panel_9 = Panel("7")  # disabled
unit_z_4 = UnitZ(Factor=panel_7)  # disabled
unit_z_5 = UnitZ(Factor=panel_8)  # disabled
unit_z_6 = UnitZ(Factor=panel_9)  # disabled
geometry_6 = Geometry(rectangle_4.Rectangle)  # disabled
# Rectangle A = Roof (Area max 1600 SF)
# Rectangle B = Room (Area max 800 SF)
# Rectangle C = Plinth  (Area max1200 SF)
geometry_7 = Geometry(geometry_6)  # disabled
offsrf = OffsetSurface(Surface=<missing>, Distance=<missing>, BothSides=0, CreateSolid=True)
geometry_8 = Geometry(rectangle_2.Rectangle)  # disabled
geometry_9 = Geometry(geometry_8)  # disabled
geometry_10 = Geometry(geometry_8)  # disabled
evaluate_surface = EvaluateSurface(Surface=reparameterize(geometry_10), Point=md_slider)  # -> Point, Normal, UDirection, VDirection, Frame; disabled
extrude = Extrude(Base=geometry_10, Direction=unit_z_3)  # disabled
evaluate_curve_3 = EvaluateCurve(Curve=reparameterize(geometry_10), Parameter=number_slider_10)  # -> Point, Tangent, Angle; disabled
evaluate_curve_4 = EvaluateCurve(Curve=reparameterize(geometry_10), Parameter=number_slider_14)  # -> Point, Tangent, Angle; disabled
evaluate_curve_5 = EvaluateCurve(Curve=reparameterize(geometry_10), Parameter=number_slider_11)  # -> Point, Tangent, Angle; disabled
evaluate_curve_6 = EvaluateCurve(Curve=reparameterize(geometry_10), Parameter=number_slider_15)  # -> Point, Tangent, Angle; disabled
evaluate_curve_7 = EvaluateCurve(Curve=reparameterize(geometry_10), Parameter=number_slider_12)  # -> Point, Tangent, Angle; disabled
evaluate_curve_8 = EvaluateCurve(Curve=reparameterize(geometry_10), Parameter=number_slider_13)  # -> Point, Tangent, Angle; disabled
move_8 = Move(Geometry=evaluate_curve_5.Point, Motion=unit_z_4)  # -> Geometry, Transform; disabled
move_9 = Move(Geometry=evaluate_curve_6.Point, Motion=unit_z_5)  # -> Geometry, Transform; disabled
move_10 = Move(Geometry=evaluate_curve_8.Point, Motion=unit_z_6)  # -> Geometry, Transform; disabled
geometry_11 = Geometry(rectangle_3.Rectangle)  # disabled
# Pick Three Points within a 50'x50 boundary rectangle.
geometry_12 = Geometry(geometry_11)  # disabled
deconstruct_brep = DeconstructBrep(Brep=geometry_11)  # -> Faces, graft(Edges), Vertices; disabled
explode_tree = ExplodeTree(Data=simplify(deconstruct_brep.Edges))  # -> Branch0, Branch1, Branch2, Branch3; disabled

# ---- group: Swap these for rotated ridge direction
geometry_13 = Geometry(explode_tree.Branch0)  # disabled
geometry_14 = Geometry(explode_tree.Branch1)  # disabled
geometry_15 = Geometry(explode_tree.Branch2)  # disabled
geometry_16 = Geometry(explode_tree.Branch3)  # disabled

# ----
box_2pt_2 = Box2Pt(PointA=evaluate_curve_3.Point, PointB=move_8.Geometry, Plane=PlaneXY(0, 0, 0))  # disabled
box_2pt_3 = Box2Pt(PointA=evaluate_curve_4.Point, PointB=move_9.Geometry, Plane=PlaneXY(0, 0, 0))  # disabled
box_2pt_4 = Box2Pt(PointA=evaluate_curve_7.Point, PointB=move_10.Geometry, Plane=PlaneXY(0, 0, 0))  # disabled
evaluate_curve_9 = EvaluateCurve(Curve=reparameterize(geometry_14), Parameter=number_slider_8)  # -> Point, Tangent, Angle; disabled
evaluate_curve_10 = EvaluateCurve(Curve=reparameterize(geometry_16), Parameter=number_slider_9)  # -> Point, Tangent, Angle; disabled
number_slider_21 = Slider(0, range=0..1)  # disabled
roof_area_2 = Panel(move_5.Geometry)  # disabled
number_slider_22 = Slider(1, range=0..1)  # disabled
number_slider_23 = Slider(1, range=0..1)  # disabled
number_slider_24 = Slider(1, range=0..1)  # disabled
line = Line(StartPoint=evaluate_curve_9.Point, EndPoint=evaluate_curve_10.Point)  # disabled
surface_split = SurfaceSplit(Surface=deconstruct_brep.Faces, Curves=line)  # -> graft(Fragments); disabled
explode_tree_2 = ExplodeTree(Data=simplify(surface_split))  # -> Branch0, Branch1, Branch2, Branch3; disabled
number_slider_25 = Slider(5, range=1..10)  # disabled
number_slider_26 = Slider(1, range=1..10)  # disabled
panel_10 = Panel(line)  # disabled
number_slider_27 = Slider(0.75, range=0.01..2)  # disabled
geometry_17 = Geometry(explode_tree_2.Branch0)  # disabled
geometry_18 = Geometry(explode_tree_2.Branch1)  # disabled
end_points = EndPoints(Curve=line)  # -> Start, End; disabled
divide_surface = DivideSurface(Surface=rectangle_2.Rectangle, UCount=number_slider_25, VCount=number_slider_26)  # -> Points, Normals, Parameters; disabled
vector_2pt = Vector2Pt(PointA=end_points.Start, PointB=end_points.End, Unitize=False)  # -> Vector, Length; disabled
curve_middle = CurveMiddle(Curve=line)  # disabled
nurbs_curve = NurbsCurve(Vertices=divide_surface.Points, Degree=3, Periodic=False)  # -> Curve, Length, Domain; disabled
circle = Circle(Plane=divide_surface.Points, Radius=number_slider_27)  # disabled
number_slider_28 = Slider(-1.9, range=-2..0)  # disabled
boundary_surfaces = BoundarySurfaces(Edges=geometry_6)  # disabled
unit_z_7 = UnitZ(Factor=number_slider_28)  # disabled
geometry_19 = Geometry(boundary_surfaces)  # disabled
extrude_2 = Extrude(Base=geometry_19, Direction=unit_z_7)  # disabled
number_slider_29 = Slider(0, range=0..1)  # disabled
unit_x_4 = UnitX(Factor=1)  # disabled
number_slider_30 = Slider(0.7, range=-2..2)  # disabled
unit_x_5 = UnitX(Factor=1)  # disabled
unit_z_8 = UnitZ(Factor=ridge_height)  # disabled
unit_z_9 = UnitZ(Factor=ridge_height)  # disabled
move_11 = Move(Geometry=line, Motion=unit_z_8)  # -> Geometry, Transform; disabled
# Pick 2 Points on opposite ends of the rectangle.
# Move the Surface Up a Distance
# Split the Surface with the Ridgeline
# Rotate Each Half a Certain Degree
geometry_20 = Geometry(move_11.Geometry)  # disabled
unit_z_10 = UnitZ(Factor=number_slider_30)  # disabled
number_slider_31 = Slider(4, range=0..5)  # disabled
curve_middle_2 = CurveMiddle(Curve=move_11.Geometry)  # disabled
number_slider_32 = Slider(1, range=0..1)  # disabled
number_slider_33 = Slider(-1.5, range=-5..5)  # disabled
number_slider_34 = Slider(0.28, range=0..1)  # disabled
unit_z_11 = UnitZ(Factor=number_slider_33)  # disabled
geometry_21 = Geometry(extrude_2)  # disabled

# ---- group: PLINTH
colour_swatch_2 = ColourSwatch(SwatchColor=RGB(186, 186, 186))  # disabled
custom_preview_2 = CustomPreview(Geometry=geometry_21, Material=colour_swatch_2)  # disabled

# ----
geometry_22 = Geometry()  # disabled

# ---- group: BUILDING
colour_swatch_3 = ColourSwatch(SwatchColor=RGB(186, 186, 186))  # disabled
custom_preview_3 = CustomPreview(Geometry=geometry_22, Material=colour_swatch_3)  # disabled

# ----
number_slider_35 = Slider(1, range=0..1)  # disabled
offsrf_2 = OffsetSurface(Surface=<missing>, Distance=number_slider_35, BothSides=0, CreateSolid=True)
brep_brep = BrepBrep()  # -> Curves, Points; disabled
merge = Merge(Data3=brep_brep.Curves)  # disabled

number_slider_36 = Slider(-18, range=-90..90)  # disabled
number_slider_37 = Slider(14, range=-90..90)  # disabled

rotate_3d = Rotate3D(Geometry=geometry_18, Angle=degrees(number_slider_37), Center=curve_middle, Axis=vector_2pt.Vector)  # -> Geometry, Transform; disabled
rotate_3d_2 = Rotate3D(Geometry=geometry_17, Angle=degrees(number_slider_36), Center=curve_middle, Axis=vector_2pt.Vector)  # -> Geometry, Transform; disabled
deconstruct_brep_2 = DeconstructBrep(Brep=rotate_3d_2.Geometry)  # -> Faces, graft(Edges), Vertices; disabled
deconstruct_brep_3 = DeconstructBrep(Brep=rotate_3d.Geometry)  # -> Faces, graft(Edges), Vertices; disabled
explode_tree_3 = ExplodeTree(Data=simplify(deconstruct_brep_2.Edges))  # -> Branch0, Branch1, Branch2, Branch3; disabled
explode_tree_4 = ExplodeTree(Data=simplify(deconstruct_brep_3.Edges))  # -> Branch0, Branch1, Branch2, Branch3; disabled
geometry_23 = Geometry(explode_tree_3.Branch1)  # disabled
geometry_24 = Geometry(explode_tree_4.Branch1)  # disabled
curve_middle_3 = CurveMiddle(Curve=geometry_23)  # disabled
end_points_2 = EndPoints(Curve=geometry_23)  # -> Start, End; disabled
end_points_3 = EndPoints(Curve=geometry_24)  # -> Start, End; disabled
curve_middle_4 = CurveMiddle(Curve=geometry_24)  # disabled
vector_2pt_2 = Vector2Pt(PointA=curve_middle_3, PointB=curve_middle, Unitize=False)  # -> Vector, Length; disabled
vector_2pt_3 = Vector2Pt(PointA=curve_middle_4, PointB=curve_middle, Unitize=False)  # -> Vector, Length; disabled
angle = Angle(VectorA=vector_2pt_2.Vector, VectorB=unit_x_4)  # -> Angle, Reflex; disabled
angle_2 = Angle(VectorA=vector_2pt_3.Vector, VectorB=unit_x_5)  # -> Angle, Reflex; disabled
panel_11 = Panel(deconstruct_brep_3.Edges)  # disabled
degrees = Degrees(Radians=angle.Angle)  # disabled
geometry_25 = Geometry(rotate_3d_2.Geometry)  # disabled
geometry_26 = Geometry(rotate_3d.Geometry)  # disabled
move_12 = Move(Geometry=geometry_26, Motion=unit_z_9)  # -> Geometry, Transform; disabled
move_13 = Move(Geometry=geometry_25, Motion=unit_z_9)  # -> Geometry, Transform; disabled
degrees_2 = Degrees(Radians=angle_2.Angle)  # disabled

panel_12 = Panel(degrees)  # disabled
panel_13 = Panel(degrees_2)  # disabled

brep_join = BrepJoin(Breps=flatten([move_12.Geometry, move_13.Geometry]))  # -> Breps, Closed; disabled
split_brep_2 = SplitBrep(Brep=extrude, Cutter=brep_join.Breps)  # disabled
list_item_2 = ListItem(List=split_brep_2, Index=1, Wrap=True)  # disabled
geometry_27 = Geometry(list_item_2)  # disabled
split_brep_3 = SplitBrep(Brep=geometry_27, Cutter=box_2pt_2)  # disabled
list_item_3 = ListItem(List=split_brep_3, Index=number_slider_22, Wrap=True)  # disabled
split_brep_4 = SplitBrep(Brep=list_item_3, Cutter=box_2pt_4)  # disabled
list_item_4 = ListItem(List=split_brep_4, Index=number_slider_24, Wrap=True)  # disabled
split_brep_5 = SplitBrep(Brep=list_item_4, Cutter=box_2pt_3)  # disabled
list_item_5 = ListItem(List=split_brep_5, Index=number_slider_23, Wrap=True)  # disabled
panel_14 = Panel(split_brep_3)  # disabled
geometry_28 = Geometry(brep_join.Breps)  # disabled
project_point = ProjectPoint(Point=evaluate_surface.Point, Direction=unit_z_2, Geometry=geometry_28)  # -> Point, Index; disabled
center_box = CenterBox(Base=project_point.Point, X=construct_domain_8, Y=construct_domain_9, Z=construct_domain_7)  # -> flatten(Box); disabled
split_brep_6 = SplitBrep(Brep=list_item_5, Cutter=center_box)  # disabled
list_item_6 = ListItem(List=flatten(split_brep_6), Index=number_slider_21, Wrap=True)  # disabled
split_brep_7 = SplitBrep(Brep=geometry_28, Cutter=center_box)  # disabled
list_item_7 = ListItem(List=flatten(split_brep_7), Index=number_slider_29, Wrap=True)  # disabled
geometry_29 = Geometry(list_item_7)  # disabled
extrude_3 = Extrude(Base=geometry_29, Direction=unit_z_10)  # disabled
contour = Contour(Shape=geometry_28, Point=curve_middle_2, Direction=vector_2pt.Vector, Distance=number_slider_31)  # disabled
brep_brep_2 = BrepBrep(BrepA=extrude, BrepB=brep_join.Breps)  # -> Curves, Points; disabled
merge_2 = Merge(Data1=move_11.Geometry, Data2=contour, Data3=brep_brep_2.Curves)  # disabled
extrude_4 = Extrude(Base=flatten(merge_2), Direction=unit_z_11)  # disabled
geometry_30 = Geometry(extrude_4)  # disabled
geometry_31 = Geometry(extrude_3)  # disabled

# ---- group: ROOF
colour_swatch_4 = ColourSwatch(SwatchColor=RGB(186, 186, 186))  # disabled
custom_preview_4 = CustomPreview(Geometry=geometry_31, Material=colour_swatch_4)  # disabled
